# Grasshopper definition GetData.gh (Grasshopper 1.0.8)
# plug-ins: RhinoCodePluginGH, Redback.GH

list = ValueList({"Rhino-Medium", "Rhino-Detailed", "LaserCutter"}, selected="LaserCutter")
list_2 = ValueList({"0", "1", "2"}, selected="1")
py3 = Python3Script(index=list_2, x=list)  # -> out, a
# ---------- py3: Python ----------
# r: requests
import json
import requests

r = requests.get("http://archmanucox.pythonanywhere.com/bimverse/nodes.json")
data = r.json()

a = []
index = int(index)
appendObject = None
for i in data[index]["geometryObjects"]:
    if i["name"] == x:
        if type(i["geometry"]) == type([]):
            for g in i["geometry"]:
                a.append(json.dumps(g))
                appendObject = "list"
        else:
            appendObject= json.dumps(i["geometry"])

if not appendObject:
    appendObject= json.dumps(data[index]["geometryObjects"][0]["geometry"])
if appendObject != "list":
    a.append(appendObject)
# ---------- end py3 ----------
geo = Geometry([<curve referenced from the Rhino model> x28])
deserialize_geometry_json = DeserializeGeometryJSON(Geometry=py3.a)  # -> JSONObject, PR
deserialize_geometry_json_2 = Python3Script(JO=py3.a)  # -> out, GE, PR; inputs JO: String
# ---------- deserialize_geometry_json_2: Python ----------
import json
import Rhino as rh

PR = json.dumps(json.loads(JO)["properties"])

GE = rh.Geometry.GeometryBase.FromJSON(JO)
# ---------- end deserialize_geometry_json_2 ----------
serialize_geometry = Python3Script(GE=geo, PR="{}")  # -> out, JO; inputs GE: GeometryBase
# ---------- serialize_geometry: Python ----------
import json
if not PR:
    PR = "{}"

PR = json.loads(PR)

data = json.loads(GE.ToJSON(None))
data["properties"] = PR
#print(list(data))

JO = json.dumps(data)
# ---------- end serialize_geometry ----------
geo_2 = Geometry(deserialize_geometry_json.JSONObject)
serialize_geometry_2 = SerializeGeometry(Geometry=geo, PR="{}")
object = ModelObject(Object="56a7d4fb-f670-4592-ac16-f79ad402f1f8", Geometry=geo_2)  # -> Object, Geometry, Name, Layer, Visibility, Display, Drafting, Render
information = ContentInformation(Content=geo)  # -> Content, Parent, Name, Tags
details = ContentDetails(Content=geo)  # -> Content, Id, Path, Attributes
cache = ContentCache(Content=object.Object, Action=Toggle(True))
